# Grasshopper definition AFDLC-HATCHES.gh (Grasshopper 0.9.76)
# plug-ins: LunchBox

number_slider = Slider(8, range=0..10)
crv = Curve(<curve referenced from the Rhino model>)
offset = Offset(Curve=crv, Distance=expr("-x", number_slider), Plane=PlaneXY(0, 0, 0), Corners=1)
multiplication = Multiplication(A=number_slider, B=Slider(1.5, range=0..10))
boundary = BoundarySurfaces(Edges=offset)
dim = Dimensions(Surface=boundary)  # -> UDimension, VDimension
division = Division(A=dim.UDimension, B=multiplication)
division_2 = Division(A=dim.VDimension, B=number_slider)
panel = Panel(division_2)
diamond = DiamondPanels(Surface=boundary, UDivisions=division, VDivisions=division_2)  # -> simplify(flatten(DiamondPanels)), simplify(flatten(TriPanels))
lng = ListLength(List=diamond.DiamondPanels)
lng_2 = ListLength(List=diamond.DiamondPanels)
random = Random(Range=Domain(-0.49, 2.49), Number=lng, Seed=Slider(10, range=0..10))
random_2 = Random(Range=Domain(-0.49, 1.49), Number=lng_2, Seed=Slider(11, range=0..100))
round = Round(Number=random)  # -> simplify(graft(Nearest)), Floor, Ceiling
round_2 = Round(Number=random_2)  # -> simplify(graft(Nearest)), Floor, Ceiling
p_n_c = PickNChoose(Pattern=round.Nearest, Stream0=Slider(7, range=0..10), Stream1=Slider(9, range=0..10), Stream2=Slider(11, range=0..100))  # -> flatten(Result)
debrep = DeconstructBrep(Brep=diamond.DiamondPanels)  # -> Faces, Edges, Vertices
addition = Addition(A=round_2.Nearest, B=2)
item = ListItem(List=debrep.Edges, Index=round_2.Nearest, Wrap=True)  # -> flatten(Item)
item_2 = ListItem(List=debrep.Edges, Index=addition, Wrap=True)  # -> flatten(Item)
end = EndPoints(Curve=item_2)  # -> Start, End
ln = Line(StartPoint=end.End, EndPoint=end.Start)
divide = DivideCurve(Curve=item, Count=p_n_c, Kinks=False)  # -> Points, Tangents, Parameters
divide_2 = DivideCurve(Curve=ln, Count=p_n_c, Kinks=False)  # -> Points, Tangents, Parameters
ln_2 = Line(StartPoint=divide.Points, EndPoint=divide_2.Points)  # -> simplify(Line)
